% Simulink data dictionary performCoSimulationWithGazeboDD.sldd

Gazebo_SL_Bus_gazebo_msgs_IMU = Simulink.Bus()  % MsgType=gazebo_msgs/IMU
  linear_acceleration: Bus: Gazebo_SL_Bus_gazebo_msgs_Point  % MsgType=gazebo_msgs/Point
  angular_velocity: Bus: Gazebo_SL_Bus_gazebo_msgs_Point  % MsgType=gazebo_msgs/Point
  orientation: Bus: Gazebo_SL_Bus_gazebo_msgs_Quaternion  % MsgType=gazebo_msgs/Quaternion

Gazebo_SL_Bus_gazebo_msgs_LaserScan = Simulink.Bus()  % MsgType=gazebo_msgs/LaserScan
  angle_min: double
  angle_max: double
  angle_step: double
  range_min: double
  range_max: double
  count: double
  vertical_angle_min: double
  vertical_angle_max: double
  vertical_angle_step: double
  range: double[640], DimensionsMode="Variable"  % IsVarLen=1
  intensities: double[640], DimensionsMode="Variable"  % IsVarLen=1

Gazebo_SL_Bus_gazebo_msgs_Point = Simulink.Bus()  % MsgType=gazebo_msgs/Point
  x: double
  y: double
  z: double

Gazebo_SL_Bus_gazebo_msgs_Pose = Simulink.Bus()  % MsgType=gazebo_msgs/Pose
  position: Bus: Gazebo_SL_Bus_gazebo_msgs_Point  % MsgType=gazebo_msgs/Point
  orientation: Bus: Gazebo_SL_Bus_gazebo_msgs_Quaternion  % MsgType=gazebo_msgs/Quaternion

Gazebo_SL_Bus_gazebo_msgs_Quaternion = Simulink.Bus()  % MsgType=gazebo_msgs/Quaternion
  x: double
  y: double
  z: double
  w: double

Gazebo_SL_Bus_gazebo_msgs_Image = Simulink.Bus()  % MsgType=gazebo_msgs/Image
  width: uint32
  height: uint32
  data: uint8[307200], DimensionsMode="Variable"  % IsVarLen=1
  data_type: uint8[128], DimensionsMode="Variable"  % PrimitiveStringType=string:IsVarLen=1

Gazebo_SL_Bus_gazebo_msgs_ApplyLinkWrench = Simulink.Bus()  % MsgType=gazebo_msgs/ApplyLinkWrench
  model_name: uint8[128], DimensionsMode="Variable"  % PrimitiveStringType=string:IsVarLen=1
  link_name: uint8[128], DimensionsMode="Variable"  % PrimitiveStringType=string:IsVarLen=1
  force_type: uint8[128], DimensionsMode="Variable"  % PrimitiveStringType=string:IsVarLen=1
  fx: double
  fy: double
  fz: double
  torque_type: uint8[128], DimensionsMode="Variable"  % PrimitiveStringType=string:IsVarLen=1
  tx: double
  ty: double
  tz: double
  duration: Bus: Gazebo_SL_Bus_gazebo_msgs_Time  % MsgType=gazebo_msgs/Time

Gazebo_SL_Bus_gazebo_msgs_Time = Simulink.Bus()  % MsgType=gazebo_msgs/Time
  seconds: double
  nano_seconds: double